# Grasshopper definition ExampleFile.gh (Grasshopper 1.0.8)
# plug-ins: ParkingDemo

curve = Curve(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)
curve_2 = Curve([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])

curve_3 = Curve(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)
curve_4 = Curve(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)

curve_5 = Curve([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])
curve_6 = Curve(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)

crv = Curve(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)
curve_7 = Curve(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)

curve_8 = Curve([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])
curve_9 = Curve(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)

curve_10 = Curve(<curve referenced from the Rhino model>)
curve_11 = Curve([<curve referenced from the Rhino model> x2])

curve_12 = Curve([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])
curve_13 = Curve(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)

curve_14 = Curve([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])
curve_15 = Curve(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)

curve_16 = Curve(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)
curve_17 = Curve([<curve referenced from the Rhino model> x2])  # disabled

crv_2 = Curve(reparameterize(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))
crv_3 = Curve(reparameterize(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))
crv_4 = Curve(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)
crv_5 = Curve(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)
crv_6 = Curve(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)
crv_7 = Curve(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)
crv_8 = Curve(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)
crv_9 = Curve(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)
crv_10 = Curve(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)
crv_11 = Curve(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)
crv_12 = Curve(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)
crv_13 = Curve(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)
crv_14 = Curve(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)
crv_15 = Curve(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)
crv_16 = Curve(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)
crv_17 = Curve(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)
crv_18 = Curve(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)
crv_19 = Curve(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)
crv_20 = Curve(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)
crv_21 = Curve(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)
rec = Rectangle({Plane=PlaneXY(-36.17804932, 8.812579263, 0), Size=Domain2(u=-30.67905678..30.67905678, v=-35.06732629..35.06732629)})
crv_22 = Curve(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)
crv_23 = Curve(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)
crv_24 = Curve(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)
crv_25 = Curve(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)

curve_18 = Curve(<curve referenced from the Rhino model>)
curve_19 = Curve(<curve referenced from the Rhino model>)
start_generation_fast = StartGenerationFast(
    Outline=curve_6,
    ExcludeBoundaries=curve_5,
    AddRamp=True,
    CellSizeMeters=5,
    EntranceSide=2,
    FastCellSizeMeters=5,
    FastDurationSeconds=10,
    GenerationInterval=1000,
    WasRunning=False)
sortresults = SortResults(ResetGeneration=Toggle(False), Parking=start_generation_fast)  # -> Parking, GenerationCollection
setoptimizationweights = SetOptimizationWeights(
    ParkingCollection=sortresults.GenerationCollection,
    NumberOfParkings="0.5",
    AveragePathLength="0.1",
    LegacyNonFunctionalCells=0,
    AverageTurns="0.25",
    PathLengthStdDev="0.075",
    TurnsStdDev="0.075")
deconstruct_parking_collection = DeconstructParkingCollection(GenerationCollection=sortresults.GenerationCollection)  # -> Ids, Scores
list_item = ListItem(List=deconstruct_parking_collection.Ids, Index=Slider(0, range=0..30), Wrap=True)
boolean_toggle = BooleanToggle(True)
selectparking = SelectParking(Generations=sortresults.GenerationCollection, ParkingId=list_item)
block_instance = BlockInstance(<block instance referenced from the Rhino model>)
export_top_parking_options = ExportTopParkingOptions(GenerationCollection=sortresults.GenerationCollection, CarBlock=block_instance, TopCount="20", PNGWidth=2000)  # -> SelectedOptions, Scores
preview_parking_result = PreviewParkingResult(
    Parking=selectparking,
    CarBlock=block_instance,
    BakeCars=boolean_toggle,
    BakeGradientCells=boolean_toggle,
    BakePath=boolean_toggle,
    BakeExcludedCells=boolean_toggle,
    BakeEntranceCell=boolean_toggle,
    BakeWalls=boolean_toggle)
