# Grasshopper definition TestForOutput.gh (Grasshopper 1.0.8)
# plug-ins: ParkingDemo, TT Toolbox

curve = Curve(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)
curve_2 = Curve([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])

curve_3 = Curve(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)
curve_4 = Curve(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)

curve_5 = Curve(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)
curve_6 = Curve([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])

curve_7 = Curve(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)
curve_8 = Curve([<curve referenced from the Rhino model> x2])  # disabled

crv = Curve(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)
curve_9 = Curve(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)

curve_10 = Curve(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)
curve_11 = Curve([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])

curve_12 = Curve(<curve referenced from the Rhino model>)
curve_13 = Curve([<curve referenced from the Rhino model> x2])

curve_14 = Curve(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)
curve_15 = Curve([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])

curve_16 = Curve(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)
curve_17 = Curve([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])

crv_2 = Curve(reparameterize(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))
crv_3 = Curve(reparameterize(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))
crv_4 = Curve(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)
crv_5 = Curve(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)
crv_6 = Curve(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)
crv_7 = Curve(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)
crv_8 = Curve(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)
crv_9 = Curve(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)
crv_10 = Curve(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)
crv_11 = Curve(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)
crv_12 = Curve(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)
crv_13 = Curve(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)
crv_14 = Curve(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)
crv_15 = Curve(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)
crv_16 = Curve(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)
rec = Rectangle({Plane=PlaneXY(-36.17804932, 8.812579263, 0), Size=Domain2(u=-30.67905678..30.67905678, v=-35.06732629..35.06732629)})
crv_17 = Curve(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)
crv_18 = Curve(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)
crv_19 = Curve(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)
crv_20 = Curve(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)
crv_21 = Curve(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)
crv_22 = Curve(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)
crv_23 = Curve(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)
crv_24 = Curve(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)
crv_25 = Curve(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)

path_process_with_gradiant = Slider(35, range=0..35)
capture = Button()
ciumn_trigger = Trigger(Interval=-1000, TimerInterval=1000, Target=columngridgenerator)
generster_trigger = Trigger(Interval=200, TimerInterval=200, Target=startgeneration)  # disabled
# Input Parameters
number_slider = Slider(13, range=0..100)
startgeneration = StartGeneration(AddRampToParking=Toggle(True), Outline=curve_14, ExcludeBoundary=curve_15, EntranceSide=Slider(1, range=0..3))
reset_collection = BooleanToggle(False)
setoptimizationweights = SetOptimizationWeights()
pathfinder = PathFinder(ResetGeneration=reset_collection, Parking=startgeneration)  # -> Parking, GenerationCollection
setoptimizationweights_2 = SetOptimizationWeights(
    ParkingColleciton=pathfinder.GenerationCollection,
    NumberOfParkings="1",
    TotalPathLength="0",
    MinimumNonFunctionalCells="0")

# ----
# Select Parking
deconstruct_parking_collection = DeconstructParkingCollection(GenerationCollection=pathfinder.GenerationCollection)  # -> Ids, Scores
sort_list = SortList(Keys=deconstruct_parking_collection.Scores, ValuesValuesA=deconstruct_parking_collection.Ids)  # -> Keys, reverse(ValuesValuesA)
list_item = ListItem(List=sort_list.ValuesValuesA, Index=number_slider, Wrap=True)
selectparking = SelectParking(Generations=pathfinder.GenerationCollection, ParkingId=list_item)

deconstrucparking = DeconstrucParking(Parking=selectparking)  # -> Score, PlanMatrix, PathPoints, LotInformations, Cells, SideCellsAddress, EXcludedCells, ParkingEntranceCell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
columngridgenerator = ColumnGridGenerator(Parking=selectparking)  # -> H, V, Parking
# column grid
cluster = Cluster_8(
    x_coordinate=columngridgenerator.V,
    y_coordinate=columngridgenerator.H,
    curve=deconstrucparking.PlanOutline,
    Panel=columngridgenerator.V)  # -> surface_2, colour_swatch
# path display
cluster_2 = Cluster_5(relay=deconstrucparking.PathPoints)  # -> geometry, colour_swatch
# print result and display cells
cluster_3 = Cluster_7(geometry=deconstrucparking.PlanOutline, curve=deconstrucparking.PlanOutline)  # -> test_locs, curve_2, brep, colour_swatch

# ----
# Export jpeg
data_dam = DataDam(DataDataA=cluster_3.curve_2, BufferDelay=5000000, BufferMode=0)
file_path = FilePath("G:\archtech\thesis\FatemeThesis\article\algorithm-results\results\T1\")
printresult = PrintResult(SaveFolderPath=file_path, OutlineBoundingRectangle=data_dam, ParkingName="Process", ResetPreviewSheet=capture)

# ----
# cells address
cluster_4 = Cluster_4(data_3=deconstrucparking.Cells, data=deconstrucparking.Cells, matrix=deconstrucparking.PlanMatrix)  # -> group_3, geometry, paths, panel_3, colour_swatch
# ramp display
generalrampinformation = GeneralRampInformation()  # -> RampTypes, RampOrientations
join_curves = JoinCurves(Curves=deconstrucparking.PathLines, Preserve=False)
data = Data(deconstrucparking.CellsWithGrade)

relay = Relay()
data_dam_2 = DataDam(DataDataA=relay, BufferDelay=10000000, BufferMode=0)

# ----
# path Preview
cluster_5 = Cluster_11(
    pathpts=deconstrucparking.PathPoints,
    curve_2=deconstrucparking.PlanOutline,
    curve=deconstrucparking.EXcludedCells,
    path_lines=deconstrucparking.PathLines)  # -> surface_3, relay, relay_2, curves, panel_4
data_2 = Data(cluster_5.relay_2)
data_3 = Data(cluster_5.relay)

unit_z = UnitZ(Factor=1)
cluster_6 = Cluster_3(
    L=deconstrucparking.RampInfo,
    L_2=generalrampinformation.RampOrientations,
    T=deconstrucparking.SideCellsAddress,
    T_2=generalrampinformation.RampTypes)  # -> G_2, swatch, reverse(C), G

# ----
# Distributed Chart of Collection
cluster_7 = Cluster_9(relay_2=data_dam_2)  # -> point, colour, panel
dot_display = DotDisplay(Point=cluster_7.point, Colour=cluster_7.colour, Size=cluster_7.panel)

move = Move(Geometry=cluster_5.relay_2, Motion=unit_z)  # -> Geometry, Transform

# ----
# Start Cell
data_4 = Data(deconstrucparking.ParkingEntranceCell)
surface = Surface(data_4)
custom_preview = CustomPreview(Geometry=surface, Material="142,12,12")

text_tag_3d = TextTag3D(
    Location=cluster_4.geometry,
    Text=graft(cluster_4.paths),
    Size=cluster_4.panel_3,
    Colour=cluster_4.colour_swatch,
    Justification=5)
custom_preview_2 = CustomPreview(Geometry=cluster_2.geometry, Material=cluster_2.colour_swatch)
custom_preview_3 = CustomPreview(Geometry=cluster_4.group_3, Material=cluster_4.colour_swatch)
custom_preview_4 = CustomPreview(Geometry=cluster_3.brep, Material=cluster_3.colour_swatch)
custom_preview_5 = CustomPreview(Geometry=cluster.surface_2, Material=cluster.colour_swatch)
custom_preview_6 = CustomPreview(Geometry=cluster_5.relay_2, Material=cluster_5.panel_4)
custom_preview_7 = CustomPreview(Geometry=move.Geometry, Material=ColourSwatch(SwatchColor=RGB(24, 82, 79)))
move_2 = Move(Geometry=cluster_6.G_2, Motion=Vector(0, 0, 10))  # -> Geometry, Transform
move_3 = Move(Geometry=cluster_6.G, Motion=Vector(0, 0, 10))  # -> Geometry, Transform
preview = CustomPreview(Geometry=move_3.Geometry, Material=ColourSwatch(SwatchColor=RGB(0, 0, 0)))
preview_2 = CustomPreview(Geometry=move_2.Geometry, Material=cluster_6.C)

# ----
# Write to Excell
file_path_2 = FilePath("G:\archtech\thesis\FatemeThesis\Algorithm\export\test for export.xlsx")

# ----
# Set Excel File Attributes
cluster_8 = Cluster_13(file=file_path_2, generation_collection=pathfinder.GenerationCollection)  # -> options, data, col_names; disabled

write_to_excel = WriteToExcel(
    Run=Toggle(True),
    ExcelWorksheet="1",
    ColumnNames=cluster_8.col_names,
    WriteOptions="None",
    ColumnnsOrRows=True,
    DataToWriteIntoColumns=cluster_8.data)  # disabled

# ----
# Vertical Access Preview
colour_swatch = ColourSwatch(SwatchColor=RGBA(0, 0, 0, 217))
surface_2 = Surface(deconstrucparking.EXcludedCells)
region_union = RegionUnion(Curves=surface_2)
area = Area(Geometry=region_union)  # -> Area, Centroid
text_tag = TextTag(Location=area.Centroid, Text="vertical access", Colour=ColourSwatch(SwatchColor=RGB(242, 242, 242)))

move_4 = Move(Geometry=surface_2, Motion="0,0,0.7")  # -> Geometry, Transform
custom_preview_8 = CustomPreview(Geometry=data_3, Material="255,255,255")

custom_preview_9 = CustomPreview(Geometry=move_4.Geometry, Material=ColourSwatch(SwatchColor=RGB(0, 0, 0)))

# ----
# Path Process with Gradiant
cluster_9 = Cluster_14(path_cells=data, index=path_process_with_gradiant, parking=selectparking, colour=cluster_5.panel_4)  # -> max_path_length_2, total_path_length_2, result, path_with_gradiant_2, gradiant_color_2

split_tree = SplitTree(Data=deconstrucparking.LotInformations, Masks=flatten(cluster_9.result))  # -> Positive, Negative

# ----
# lable display
cluster_10 = Cluster_12(
    parkings=split_tree.Positive,
    avg_len=cluster_9.total_path_length_2,
    B=cluster_9.max_path_length_2,
    geometry_2=deconstrucparking.PlanOutline,
    fragment_b=deconstrucparking.Score,
    geometry=deconstrucparking.PlanOutline,
    generation_time=deconstrucparking.GenerationTime,
    avg_circulation_turns=deconstrucparking.AvgDirectionShift,
    circulation_turns=deconstrucparking.PathDirectionShift)  # -> count, len, score, run_time, circulation_turns_2
merge = Merge(
    Data1=cluster_10.count,
    Data3=cluster_10.len,
    Data4=cluster_10.circulation_turns_2,
    Data5=cluster_10.run_time,
    Data6=cluster_10.score)
text_tag_3d_2 = TextTag3D(Location=cluster_3.test_locs, Text=flatten(merge), Size=1, Colour=colour_swatch, Justification=7)

cluster_11 = Cluster(T_2=split_tree.Positive, T=split_tree.Positive, whole=deconstrucparking.LotInformations)  # -> G, swatch, data_3, swatch_2
move_5 = Move(Geometry=cluster_9.path_with_gradiant_2, Motion="0,0,0.5")  # -> Geometry, Transform
preview_3 = CustomPreview(Geometry=cluster_11.data_3, Material=cluster_11.swatch_2)
preview_4 = CustomPreview(Geometry=cluster_11.G, Material=ColourSwatch(SwatchColor=RGBA(108, 112, 110, 164)))
preview_5 = CustomPreview(Geometry=cluster_11.G, Material=cluster_11.swatch)

custom_preview_10 = CustomPreview(Geometry=move_5.Geometry, Material=cluster_9.gradiant_color_2)

# ==== cluster Cluster
whole = ClusterInput()
T = ClusterInput()
T_2 = ClusterInput()
swatch = ClusterOutput(ColourSwatch(SwatchColor=RGB(0, 0, 0)))

# ----
# parking lots display
crv = Curve([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])
surface = Surface([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])
group = Group(Objects=crv)
rotate = Rotate(Geometry=group, Angle=degrees("180"), Plane=PlaneXY(0, 0, 0))  # -> Geometry, Transform
transform = Transform(Geometry=rotate.Geometry, Transform=T)
data = Data(transform)

group_2 = Group(Objects=surface)

rotate_2 = Rotate(Geometry=group_2, Angle=degrees("180"), Plane=PlaneXY(0, 0, 0))  # -> Geometry, Transform
crv_2 = Curve(rotate_2.Geometry)
transform_2 = Transform(Geometry=rotate_2.Geometry, Transform=T_2)
data_2 = Data(transform_2)

transform_3 = Transform(Geometry=rotate.Geometry, Transform=whole)
data_3 = ClusterOutput(data)
swatch_2 = ClusterOutput(ColourSwatch(SwatchColor=RGB(9, 10, 9)))
G = ClusterOutput(transform_3)

# ==== cluster Cluster_3
T = ClusterInput()
L = ClusterInput()
T_2 = ClusterInput()
L_2 = ClusterInput()

# ----
# ramp info:
# 0: side
# 1: cell index on its side
# 2: ramp type
# 3: orientation
item = ListItem(List=L, Index=0, Wrap=True)  # -> Item, Item1, Item2, Item3

branch = TreeBranch(Tree=T, Path=item.Item, MaintainPaths=True)
branch_2 = TreeBranch(Tree=T_2, Path=item.Item2, MaintainPaths=True)
number_slider = Slider(5, range=0..10)
item_2 = ListItem(List=branch, Index=item.Item1, Wrap=True)
multiplication = Multiplication(A=branch_2, B=5)
addition = Addition(A=multiplication, B=item_2, C="{-2.5,-2.5,0}")
rectangle = Rectangle(Plane=addition, XSize=number_slider, YSize=number_slider, Radius=0)  # -> Rectangle, Length
item_3 = ListItem(List=rectangle.Rectangle, Index=0, Wrap=True)
boundary = BoundarySurfaces(Edges=rectangle.Rectangle)
lng = ListLength(List=rectangle.Rectangle)
area = Area(Geometry=item_3)  # -> Area, Centroid
cluster = Cluster_2(i=item.Item2, T="{-2.5,-2.5,0}")
range = Range(Domain="0 to 0.8", Steps=expr("x-1", lng))  # -> reverse(Range)
item_4 = ListItem(List=L_2, Index=item.Item3, Wrap=True)
move = Move(Geometry=boundary, Motion=expr("-x", area.Centroid))  # -> Geometry, Transform
gradient = Gradient(LowerLimit=0, UpperLimit=1, Parameter=range, stops=[0: RGB(102, 98, 94), 1: RGB(20, 111, 222), 1: RGB(255, 208, 0)])
transform = Transform(Geometry=move.Geometry, Transform=item_4)
transform_2 = Transform(Geometry=cluster, Transform=item_4)
move_2 = Move(Geometry=transform, Motion=area.Centroid)  # -> Geometry, Transform
move_3 = Move(Geometry=transform_2, Motion=area.Centroid)  # -> Geometry, Transform
swatch = ClusterOutput(ColourSwatch(SwatchColor=RGB(186, 168, 168)))
G = ClusterOutput(move_3.Geometry)
G_2 = ClusterOutput(move_2.Geometry)
C = ClusterOutput(gradient)

# ==== cluster Cluster_4
data = ClusterInput()
data_2 = Data(data)
matrix = ClusterInput()
data_3 = ClusterInput()

deconstruct_matrix = DeconstructMatrix(Matrix=matrix)  # -> Rows, Columns, Values
plasticanchor = PlasticAnchor(Limit=1, Strength=1, Reset=False)
data_4 = Data(data_3)
partition_list = PartitionList(List=deconstruct_matrix.Values, Size=deconstruct_matrix.Columns)
area = Area(Geometry=data_4)  # -> Area, Centroid
partition_list_2 = PartitionList(List=partition_list, Size="1")  # -> simplify(Chunks)

# ---- group: to remove 0 items in matrix
equality = Equality(FirstNumber=partition_list_2, SecondNumber=0)  # -> Equality, Inequality
tree_statistics = TreeStatistics(Tree=partition_list_2)  # -> Paths, Length, Count
dispatch = Dispatch(List=tree_statistics.Paths, DispatchPattern=flatten(equality.Inequality))  # -> ListA, ListB
tree_branch = TreeBranch(Tree=partition_list_2, Path=dispatch.ListA, MaintainPaths=True)

# ----
tree_statistics_2 = TreeStatistics(Tree=area.Centroid)  # -> Paths, Length, Count
tree_branch_2 = TreeBranch(Tree=partition_list_2, Path=tree_statistics_2.Paths, MaintainPaths=True)
move = Move(Geometry=area.Centroid, Motion="-1.7,-1.7,0")  # -> Geometry, Transform
tree_statistics_3 = TreeStatistics(Tree=tree_branch_2)  # -> Paths, Length, Count
panel = Panel("1")

panel_2 = Panel("""0.3
0.5
0.2""")
group = Group(Objects=data_2)
dash = DashPattern(Curve=data_2, Pattern=panel_2)  # -> Dashes, Gaps
colour_swatch = ClusterOutput(ColourSwatch(SwatchColor=RGB(0, 0, 0)))
geometry = ClusterOutput(move.Geometry)
panel_3 = ClusterOutput("0.5")
paths = ClusterOutput(tree_statistics_3.Paths)
panel_4 = Panel(dash.Dashes)
group_2 = Group(Objects=dash.Dashes)
group_3 = ClusterOutput(group_2)

# ==== cluster Cluster_5
relay = ClusterInput()

curve = Curve(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)
data = Data(relay)
area = Area(Geometry=curve)  # -> Area, Centroid
subtraction = Subtraction(A=data, B=area.Centroid)
surface = Surface(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)
graft_tree = GraftTree(Tree=subtraction, IncludeEmptyLists=True, IncludeNullItems=True)
move = Move(Geometry=surface, Motion=graft_tree)  # -> flatten(Geometry), Transform

geometry = ClusterOutput(move.Geometry)
colour_swatch = ClusterOutput(ColourSwatch(SwatchColor=RGB(160, 181, 136)))

# ==== cluster Cluster_7
geometry = ClusterInput()
curve = ClusterInput()

# ----
# preview outline
cluster = Cluster_6(curve=curve)

brep = ClusterOutput(cluster)
colour_swatch = ClusterOutput(ColourSwatch(SwatchColor=RGB(0, 0, 0)))
series = Series(Start="-3", Step="-2.5", Count="5")
construct_point = ConstructPoint(XCoordinate="5", YCoordinate=series, ZCoordinate=0)
test_locs = ClusterOutput(construct_point)

# ---- group: save preview results
bounding_rectangle = BoundingRectangle(Geometry=geometry, Plane=PlaneXY(0, 0, 0), Axis=0, Slide=0, Union=True)  # -> Bounding, DimensionX, DimensionY
rectangle = Rectangle(bounding_rectangle.Bounding)
boolean_toggle = BooleanToggle(True)

# ----
subtraction = Subtraction(A=bounding_rectangle.DimensionY, B=5)
addition = Addition(A=bounding_rectangle.DimensionX, B=5)
addition_2 = Addition(A=bounding_rectangle.DimensionX, B="15")
data = Data(flatten([bounding_rectangle.Bounding, construct_point]))
bounding_rectangle_2 = BoundingRectangle(Geometry=data, Plane=PlaneXY(0, 0, 0), Axis=0, Slide=0, Union=True)  # -> Bounding, DimensionX, DimensionY

# ---- group: save preview results (continued)
offset_curve = OffsetCurve(Curve=bounding_rectangle_2.Bounding, Distance="3", Corners=1)

# ----
curve_2 = ClusterOutput(offset_curve)

# ==== cluster Cluster_8
x_coordinate = ClusterInput()
y_coordinate = ClusterInput()
construct_point = ConstructPoint(XCoordinate=graft(x_coordinate), YCoordinate=y_coordinate, ZCoordinate=0)
curve = ClusterInput()
panel = Panel(ClusterInput())
point_in_curve = PointInCurve(Point=construct_point, Curve=curve)  # -> Relationship, Point
equality = Equality(FirstNumber=point_in_curve.Relationship, SecondNumber="0")  # -> Equality, Inequality
dispatch = Dispatch(List=construct_point, DispatchPattern=equality.Inequality)  # -> ListA, ListB
data = Data(dispatch.ListA)

division = Division(A="0.5", B=-2)
unit_x = UnitX(Factor=division)
unit_y = UnitY(Factor=division)
addition = Addition(A=unit_x, B=unit_y)
move = Move(Geometry=data, Motion=addition)  # -> Geometry, Transform

circle = Circle(Plane=data, Radius=".3")
rectangle = Rectangle(Plane=move.Geometry, XSize="0.5", YSize="0.5", Radius=0)  # -> Rectangle, Length
# display columns
surface = Surface(circle)
colour_swatch = ClusterOutput(ColourSwatch(SwatchColor=RGB(0, 15, 51)))
surface_2 = ClusterOutput(surface)

# ==== cluster Cluster_9
relay = ClusterInput()
relay_2 = ClusterInput()
selectparking = SelectParking(Generations=relay, ParkingId=relay_2)
deconstrucparking = DeconstrucParking(Parking=graft(selectparking))  # -> Score, PlanMatrix, PathPoints, LotInformations, Cells, SideCellsAddress, EXcludedCells, ParkingEntranceCell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
deconstruct_matrix = DeconstructMatrix(Matrix=deconstrucparking.PlanMatrix)  # -> Rows, Columns, Values
# path
equality = Equality(FirstNumber=deconstruct_matrix.Values, SecondNumber="3")  # -> Equality, Inequality
# lot
equality_2 = Equality(FirstNumber=deconstruct_matrix.Values, SecondNumber="2")  # -> Equality, Inequality
# Distributed Chart of collection
number_slider = Slider(100, range=0..100)
mass_addition = MassAddition(Input=equality_2.Equality)  # -> flatten(Result), PartialResults
mass_addition_2 = MassAddition(Input=equality.Equality)  # -> flatten(Result), PartialResults
multiplication = Multiplication(A=deconstrucparking.Score, B=number_slider)  # -> flatten(Result)
construct_point = ConstructPoint(XCoordinate=mass_addition.Result, YCoordinate=mass_addition_2.Result, ZCoordinate=expr("x/2", multiplication))
point = ClusterOutput(construct_point)
colour_rgb = ColourRGB(Alpha="255", Red=expr("x*5", multiplication), Green=expr("x*2", multiplication), Blue=Slider(49, range=0..1000))  # -> reverse(Colour)
panel = ClusterOutput(".5")
colour = ClusterOutput(colour_rgb)

# ==== cluster Cluster_11
pathpts = ClusterInput()
pathpts_2 = Data(flatten(pathpts))
path_lines = ClusterInput()
curve = ClusterInput()
point_in_curve = PointInCurve(Point=pathpts_2, Curve=graft(curve))  # -> Relationship, Point
explode_tree = ExplodeTree(Data=point_in_curve.Relationship)  # -> _0000, _0001, _0002, Branch3
addition = Addition(A=explode_tree._0000, B=explode_tree._0001, C=explode_tree._0002, D=explode_tree.Branch3)
curve_2 = ClusterInput()
equality = Equality(FirstNumber=addition, SecondNumber="0")  # -> Equality, Inequality
point_in_curve_2 = PointInCurve(Point=pathpts_2, Curve=curve_2)  # -> Relationship, Point
equality_2 = Equality(FirstNumber=point_in_curve_2.Relationship, SecondNumber="2")  # -> Equality, Inequality
gate_and = GateAnd(A=equality_2.Equality, B=equality.Equality)
dispatch = Dispatch(List=pathpts_2, DispatchPattern=gate_and)  # -> ListA, ListB
mst = MST(BasePoints=dispatch.ListA)  # -> PointPointTopology, ConnectionPointTopology, Lines
length = Length(Curve=mst.Lines)

# ----
# filter conncetion lines not
# vertical or horizontal
cluster = Cluster_10(first_number=length, list=mst.Lines)

number_slider = Slider(0.3, range=0..1)
# path display
join_curves = JoinCurves(Curves=path_lines, Preserve=False)
offset_curve = OffsetCurve(Curve=join_curves, Distance=expr("-x", number_slider), Corners=1)
offset_curve_2 = OffsetCurve(Curve=join_curves, Distance=number_slider, Corners=1)
end_points = EndPoints(Curve=offset_curve_2)  # -> Start, End
end_points_2 = EndPoints(Curve=offset_curve)  # -> Start, End
line = Line(StartPoint=end_points.Start, EndPoint=end_points_2.Start)
line_2 = Line(StartPoint=end_points.End, EndPoint=end_points_2.End)
join_curves_2 = JoinCurves(Curves=[offset_curve_2, offset_curve, line, line_2], Preserve=False)
region_union = RegionUnion(Curves=flatten(join_curves_2))
fillet_distance = FilletDistance(Curve=region_union, Distance=Slider(0.2, range=0..1))
surface = Surface(fillet_distance)

curves = ClusterOutput(join_curves)
number_slider_2 = Slider(0.1, range=0..1)

panel = Panel("""1.5
1""")
number_slider_3 = Slider(0.1, range=0..0.1)
dash_pattern = DashPattern(Curve=join_curves, Pattern=panel)  # -> Dashes, Gaps
panel_2 = Panel(".04")
offset_curve_3 = OffsetCurve(Curve=dash_pattern.Dashes, Distance=expr("-x", number_slider_2), Corners=1)
offset_curve_4 = OffsetCurve(Curve=dash_pattern.Dashes, Distance=number_slider_2, Corners=1)
end_points_3 = EndPoints(Curve=offset_curve_4)  # -> Start, End
end_points_4 = EndPoints(Curve=offset_curve_3)  # -> Start, End
line_3 = Line(StartPoint=end_points_3.Start, EndPoint=end_points_4.Start)
line_4 = Line(StartPoint=end_points_3.End, EndPoint=end_points_4.End)
join_curves_3 = JoinCurves(Curves=[line_3, line_4, offset_curve_4, offset_curve_3], Preserve=False)
panel_3 = Panel("11,11,45")
surface_2 = Surface(join_curves_3)

panel_4 = ClusterOutput("229,229,26")
surface_3 = ClusterOutput(surface_2)
relay = ClusterOutput(surface_2)
relay_2 = ClusterOutput(surface)

# ==== cluster Cluster_12
avg_len = ClusterInput()
B = ClusterInput()
parkings = ClusterInput()
list_length = ListLength(List=flatten(parkings))  # -> expr("x*2", Length)
geometry = ClusterInput()
geometry_2 = ClusterInput()
avg_circulation_turns = ClusterInput()
generation_time = ClusterInput()
circulation_turns = ClusterInput()
area = Area(Geometry=geometry_2)  # -> Area, Centroid
area_2 = Area(Geometry=geometry)  # -> Area, Centroid
fragment_b = ClusterInput()
panel = Panel("m2")
concatenate = Concatenate(Fragment_A="Avg Turns: ", Fragment_B=avg_circulation_turns, A="    ", B="Total Turns: ", C=circulation_turns)
concatenate_2 = Concatenate(FragmentA="Run Time(ms): ", FragmentB=generation_time)
concatenate_3 = Concatenate(Fragment_A="Avg Path Length: ", Fragment_B=avg_len, C="   ", A="Max Path Length: ", B=B)
concatenate_4 = Concatenate(Fragment_A="Parking Count:", Fragment_B=list_length, A="   ", C=area.Area)
concatenate_5 = Concatenate(FragmentA="Parking Score: ", FragmentB=fragment_b)
circulation_turns_2 = ClusterOutput(concatenate)
len = ClusterOutput(concatenate_3)
run_time = ClusterOutput(concatenate_2)
# add lable to results
count = ClusterOutput(concatenate_4)
score = ClusterOutput(concatenate_5)

# ==== cluster Cluster_13
generation_collection = ClusterInput()
file = ClusterInput()
deconstruct_parking_collection = DeconstructParkingCollection(GenerationCollection=generation_collection)  # -> Ids, Scores
write_options = WriteOptions(
    FilePath=file,
    ClearDataOverwrite=True,
    SaveAfterWrite=False,
    CloseAfterWrite=False,
    ColumnStartPosition=1,
    RowStartPosition=1)  # -> UserMessages, WriteOptions
sort_list = SortList(Keys=deconstruct_parking_collection.Scores, ValuesValuesA=deconstruct_parking_collection.Ids)  # -> Keys, reverse(ValuesValuesA)
selectparking = SelectParking(Generations=generation_collection, ParkingId=sort_list.ValuesValuesA)
getpathlength = GetPathLength(Parking=selectparking)  # -> MaxLength, AvgLength
deconstrucparking = DeconstrucParking(Parking=selectparking)  # -> Score, PlanMatrix, PathPoints, LotInformations, Cells, SideCellsAddress, EXcludedCells, ParkingEntranceCell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
panel = Panel("""Index
 ID
P Count
 Area
Avg Len
Max Len
Avg Turns
Max Turns
p Score
Run Time""")
area = Area(Geometry=deconstrucparking.PlanOutline)  # -> Area, Centroid
multiplication = Multiplication(A=deconstrucparking.LotCount, B=2)
item_index = ItemIndex(List=deconstruct_parking_collection.Ids, Item=deconstruct_parking_collection.Ids)
score = GraftTree(LotCount=multiplication, IncludeEmptyLists=True, IncludeNullItems=True)
avg_shift = GraftTree(AvgShift=deconstrucparking.AvgDirectionShift, IncludeEmptyLists=True, IncludeNullItems=True)
avg_shift_2 = GraftTree(AvgLen=getpathlength.AvgLength, IncludeEmptyLists=True, IncludeNullItems=True)
all_shift = GraftTree(AllShift=deconstrucparking.PathDirectionShift, IncludeEmptyLists=True, IncludeNullItems=True)
all_shift_2 = GraftTree(AllLen=getpathlength.MaxLength, IncludeEmptyLists=True, IncludeNullItems=True)
score_2 = GraftTree(Score=deconstrucparking.Score, IncludeEmptyLists=True, IncludeNullItems=True)
score_3 = GraftTree(Index=item_index, IncludeEmptyLists=True, IncludeNullItems=True)
score_4 = GraftTree(Tree=deconstrucparking.GenerationTime, IncludeEmptyLists=True, IncludeNullItems=True)
score_5 = GraftTree(Tree=area.Area, IncludeEmptyLists=True, IncludeNullItems=True)
score_6 = GraftTree(Tree=deconstruct_parking_collection.Ids, IncludeEmptyLists=True, IncludeNullItems=True)
merge = Merge(
    Data1=score_3,
    Data2=score_6,
    Data3=score,
    Data4=score_5,
    Data5=avg_shift_2,
    Data6=all_shift_2,
    Data7=avg_shift,
    Data8=all_shift,
    Data9=score_2,
    Data10=score_4)
col_names = ClusterOutput(panel)
options = ClusterOutput(write_options.WriteOptions)
data = ClusterOutput(merge)

# ==== cluster Cluster_14
path_cells = ClusterInput()
index = ClusterInput()
parking = ClusterInput()
path_cells_2 = Data(path_cells)
index_2 = Data(index)
parking_2 = Data(parking)

concatenate = Concatenate(Fragment_A="{0 to ", Fragment_B=index_2, A="}[?]")

concatenate_2 = Concatenate(Fragment_A="{", Fragment_B=index_2, A="}[?]")

result = ClusterOutput(concatenate)
colour = ClusterInput()

# ----
# Path Process Display
getpathlength = GetPathLength(Parking=parking_2)  # -> MaxLength, TotalLength
total_path_length = Data(getpathlength.TotalLength)
max_path_length = Data(getpathlength.MaxLength)
boundary_surfaces = BoundarySurfaces(Edges=path_cells_2)
split_tree = SplitTree(Data=boundary_surfaces, Masks=flatten(concatenate_2))  # -> Positive, Negative
concatenate_3 = Concatenate(FragmentA="G", FragmentB=index_2)
area = Area(Geometry=split_tree.Positive)  # -> Area, Centroid
custom_preview = CustomPreview(Geometry=split_tree.Positive, Material=ColourSwatch(SwatchColor=RGB(0, 0, 0)))
colour_2 = Colour(colour)
text_tag_3d = TextTag3D(
    Location=area.Centroid,
    Text=concatenate_3,
    Size="1.5",
    Colour=ColourSwatch(SwatchColor=RGB(255, 247, 247)),
    Justification=5)

max_path_length_2 = ClusterOutput(max_path_length)
total_path_length_2 = ClusterOutput(total_path_length)

one_over_x = OneOverX(Value=max_path_length)
series = Series(Start="0", Step=one_over_x, Count=index_2)
gradient = Gradient(LowerLimit="0", UpperLimit="0.9", Parameter=series, stops=[0: RGB(242, 255, 0), 1: RGB(255, 0, 0)])
split_tree_2 = SplitTree(Data=boundary_surfaces, Masks=flatten(concatenate))  # -> Positive, Negative

number_slider = Slider(-2.2, range=-2.2..-0.1)
region_union = RegionUnion(Curves=flatten(split_tree_2.Positive))
offset_curve = OffsetCurve(Curve=region_union, Distance=expr("x-0.1", number_slider), Corners=1)
offset_curve_2 = OffsetCurve(Curve=region_union, Distance=number_slider, Corners=1)
colour_swatch = ColourSwatch(SwatchColor=RGB(9, 9, 64))
surface = Surface([offset_curve_2, offset_curve])

custom_preview_2 = CustomPreview(Geometry=surface, Material=graft(colour_2))
custom_preview_3 = CustomPreview(Geometry=split_tree_2.Positive, Material=graft(gradient))

gradiant_color = Data(graft(gradient))
path_with_gradiant = Data(split_tree_2.Positive)
path_with_gradiant_2 = ClusterOutput(path_with_gradiant)
gradiant_color_2 = ClusterOutput(gradiant_color)

# ==== cluster Cluster_2
i = ClusterInput()
T = ClusterInput()

geo = Geometry([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])
join = JoinCurves(Curves=geo, Preserve=False)
geo_2 = Geometry([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])
geo_3 = Geometry([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])
geo_4 = Geometry([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])
geo_5 = Geometry([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])
geo_6 = Geometry([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])
group = Group(Objects=geo)
group_2 = Group(Objects=geo_4)
group_3 = Group(Objects=geo_3)
group_4 = Group(Objects=geo_6)
group_5 = Group(Objects=geo_5)
group_6 = Group(Objects=geo_2)
merge = Merge(Data1=group, Data2=group_2, Data3=group_3, Data4=group_4, Data5=group_5, Data6=group_6)
item = ListItem(List=merge, Index=i, Wrap=True)
scale = Scale(Geometry=item, Center=Point(0, 0, 0), Factor="5")  # -> Geometry, Transform
move = Move(Geometry=scale.Geometry, Motion=T)  # -> Geometry, Transform
rotate = Rotate(Geometry=move.Geometry, Angle="pi/2", Plane=PlaneXY(0, 0, 0))  # -> Geometry, Transform

G = ClusterOutput(rotate.Geometry)

# ==== cluster Cluster_6
curve = ClusterInput()
data = ClusterInput()
simplify_curve = SimplifyCurve(Curve=curve)  # -> Curve, Simplified
data_2 = Data(data)
offset_curve = OffsetCurve(Curve=simplify_curve.Curve, Distance=".3", Corners=1)
end_points = EndPoints(Curve=simplify_curve.Curve)  # -> Start, End
end_points_2 = EndPoints(Curve=offset_curve)  # -> Start, End
line = Line(StartPoint=end_points_2.Start, EndPoint=end_points.Start)
sweep2 = Sweep2(Rail1=simplify_curve.Curve, Rail2=offset_curve, Sections=line, SameHeight=False)
brep = ClusterOutput(sweep2)

# ==== cluster Cluster_10
first_number = ClusterInput()
larger_than = LargerThan(FirstNumber=first_number, SecondNumber=0)  # -> LargerThan, OrEqualTo
list = ClusterInput()
dispatch = Dispatch(List=list, DispatchPattern=larger_than.LargerThan)  # -> ListA, ListB
unit_x = UnitX(Factor="1")
angle = Angle(VectorA=dispatch.ListA, VectorB=unit_x)  # -> Angle, Reflex
equality = Equality(FirstNumber=angle.Angle, SecondNumber="0")  # -> Equality, Inequality
equality_2 = Equality(FirstNumber=angle.Angle, SecondNumber="0.5 * pi")  # -> Equality, Inequality
gate_or = GateOr(A=equality_2.Equality, B=equality.Equality)
dispatch_2 = Dispatch(List=dispatch.ListA, DispatchPattern=gate_or)  # -> ListA, ListB
list_a = ClusterOutput(dispatch_2.ListA)
