# Grasshopper definition ExampleFile.gh (Grasshopper 1.0.8)
# plug-ins: ParkingDemo

curve = Curve(<curve referenced from the Rhino model>)
curve_2 = Curve(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)

curve_3 = Curve([<curve referenced from the Rhino model> x5])  # disabled
curve_4 = Curve(<curve referenced from the Rhino model>)  # disabled

start_generation = StartGeneration(Outline=curve_4, ExcludeBoundaries=curve_3, AddRamp=False, EntranceSide=0, GenerationInterval=500, WasRunning=False)  # disabled
start_generation_2 = StartGeneration(Outline=curve_2, ExcludeBoundaries=curve, AddRamp=False, EntranceSide=2, GenerationInterval=1000, WasRunning=False)
boolean_toggle = BooleanToggle(False)  # disabled
boolean_toggle_2 = BooleanToggle(True)  # disabled
boolean_toggle_3 = BooleanToggle(False)  # disabled
sortresults = SortResults(ResetGeneration=Toggle(False), Parking=start_generation_2)  # -> Parking, GenerationCollection
block_instance = BlockInstance(<block instance referenced from the Rhino model>)  # disabled
sortresults_2 = SortResults(ResetGeneration=boolean_toggle, Parking=start_generation)  # -> Parking, GenerationCollection; disabled
deconstruct_parking_collection = DeconstructParkingCollection(GenerationCollection=sortresults.GenerationCollection)  # -> Ids, Scores
number_slider = Slider(40, range=0..40)  # disabled
number_slider_2 = Slider(10, range=0..10)  # disabled
deconstruct_parking_collection_2 = DeconstructParkingCollection(GenerationCollection=sortresults_2.GenerationCollection)  # -> Ids, Scores; disabled
deconstruct_parking_collection_3 = DeconstructParkingCollection()  # -> Ids, Scores
list_item = ListItem(List=deconstruct_parking_collection.Ids, Index=Slider(4, range=0..30), Wrap=True)
panel = Panel(sortresults_2.GenerationCollection)  # disabled
list_item_2 = ListItem(List=deconstruct_parking_collection_2.Ids, Index=number_slider, Wrap=True)  # disabled
boolean_toggle_4 = BooleanToggle(True)
selectparking = SelectParking(Generations=sortresults.GenerationCollection, ParkingId=list_item)
block_instance_2 = BlockInstance(<block instance referenced from the Rhino model>)
selectparking_2 = SelectParking(Generations=sortresults_2.GenerationCollection, ParkingId=list_item_2)  # disabled
bake_parking_result = BakeParkingResult(
    Parking=selectparking_2,
    CarBlock=block_instance,
    BakeCars=boolean_toggle_2,
    BakeGradientCells=boolean_toggle_2,
    BakePath=boolean_toggle_2,
    BakeExcludedCells=boolean_toggle_2,
    BakeEntranceCell=boolean_toggle_2,
    BakeWalls=boolean_toggle_2)  # disabled
bake_parking_result_2 = BakeParkingResult(Parking=selectparking_2, CarBlock=block_instance)  # disabled
preview_parking_result = PreviewParkingResult(
    Parking=selectparking,
    CarBlock=block_instance_2,
    BakeCars=boolean_toggle_4,
    BakeGradientCells=boolean_toggle_4,
    BakePath=boolean_toggle_4,
    BakeExcludedCells=boolean_toggle_4,
    BakeEntranceCell=boolean_toggle_4,
    BakeWalls=boolean_toggle_4)
