# Grasshopper definition TestForOutput.gh (Grasshopper 1.0.7)
# plug-ins: ParkingDemo

curve = Curve(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)
curve_2 = Curve([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])

crv = Curve(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)
curve_3 = Curve(<curve referenced from the Rhino model>)

crv_2 = Curve(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)
curve_4 = Curve(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)

crv_3 = Curve(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)
curve_5 = Curve([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])

# ----
# path grade input
curve_6 = Curve(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)
curve_7 = Curve([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])

curve_8 = Curve(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)
curve_9 = Curve(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)

curve_10 = Curve([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])
curve_11 = Curve(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)

crv_4 = Curve(reparameterize(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))
crv_5 = Curve(reparameterize(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))
crv_6 = Curve(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)
crv_7 = Curve(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)
crv_8 = Curve(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)
crv_9 = Curve(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)
crv_10 = Curve(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)
crv_11 = Curve(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)
crv_12 = Curve(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)
rec = Rectangle({Plane=PlaneXY(-36.17804932, 8.812579263, 0), Size=Domain2(u=-30.67905678..30.67905678, v=-35.06732629..35.06732629)})
crv_13 = Curve(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)
crv_14 = Curve(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)
crv_15 = Curve(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)
crv_16 = Curve(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)
crv_17 = Curve(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)
crv_18 = Curve(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)
crv_19 = Curve(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)
crv_20 = Curve(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)
crv_21 = Curve(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)
crv_22 = Curve(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)
crv_23 = Curve(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)
crv_24 = Curve(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)
crv_25 = Curve(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)
crv_26 = Curve(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)
crv_27 = Curve(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)

trigger = Trigger(Interval=-1, TimerInterval=5, Target=[startgeneration, expression])  # disabled
curve_12 = Curve([<curve referenced from the Rhino model> x2])
number_slider = Slider(0, range=0..35)
curve_13 = Curve(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)

curve_14 = Curve(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)
curve_15 = Curve([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])

curve_16 = Curve(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)
curve_17 = Curve([<curve referenced from the Rhino model> x2])

curve_18 = Curve([<curve referenced from the Rhino model> x2])  # disabled
curve_19 = Curve(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)

startgeneration = StartGeneration(AddRampToParking=Toggle(True), Outline=crv_26, ExcludeBoundary=curve_5, EntranceSide=Slider(3, range=0..3))
pathfinder = PathFinder(ResetGeneration=Toggle(False), Parking=startgeneration)  # -> Parking, GenerationCollection
# grade out1
data = Data("Grasshopper.Kernel.Types.GH_ObjectWrapper")
deconstruct_parking_collection = DeconstructParkingCollection(GenerationCollection=pathfinder.GenerationCollection)  # -> Ids, Scores
data_2 = Data("Grasshopper.Kernel.Types.GH_ObjectWrapper")
sort_list = SortList(Keys=deconstruct_parking_collection.Scores, ValuesValuesA=deconstruct_parking_collection.Ids)  # -> Keys, reverse(ValuesValuesA)
list_item = ListItem(List=sort_list.ValuesValuesA, Index=Slider(21, range=0..150), Wrap=True)
selectparking = SelectParking(Generations=pathfinder.GenerationCollection, ParkingId=list_item)
deconstrucparking = DeconstrucParking(Parking=pathfinder.Parking)  # -> Score, PlanMatrix, PathPoints, LotInformations, Cells, SideCellsAddress, EXcludedCells, ParkingEntranceCell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
deconstrucparking_2 = DeconstrucParking(Parking=pathfinder.Parking)  # -> Score, PlanMatrix, PathPoints, LotInformations, Cells, SideCellsAddress, EXcludedCells, ParkingEntranceCell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
deconstrucparking_3 = DeconstrucParking(Parking=pathfinder.Parking)  # -> Score, PlanMatrix, PathPoints, LotInformations, Cells, SideCellsAddress, EXcludedCells, ParkingEntranceCell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
panel = Panel(deconstrucparking_3.AvgDirectionShift)
getpathlength = GetPathLength(Parking=pathfinder.Parking)  # -> MaxLength, TotalLength
deconstrucparking_4 = DeconstrucParking(Parking=pathfinder.Parking)  # -> Score, PlanMatrix, PathPoints, LotInformations, Cells, SideCellsAddress, EXcludedCells, ParkingEntranceCell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
trigger_2 = Trigger(Interval=-1000, TimerInterval=1000, Target=columngridgenerator)

concatenate = Concatenate(Fragment_A="{0 to ", Fragment_B=number_slider, A="}[?]")

concatenate_2 = Concatenate(Fragment_A="{", Fragment_B=number_slider, A="}[?]")

columngridgenerator = ColumnGridGenerator(Parking=pathfinder.Parking)  # -> H, V, Parking
# parking lots display
display_matrix = DisplayMatrix(deconstrucparking_3.PlanMatrix)
# column grid
cluster = Cluster_8(
    x_coordinate=columngridgenerator.V,
    y_coordinate=columngridgenerator.H,
    curve=deconstrucparking_3.PlanOutline,
    Panel=columngridgenerator.V)  # -> surface_2, colour_swatch
# path display
cluster_2 = Cluster_5(relay=deconstrucparking_3.PathPoints)  # -> geometry, colour_swatch
# print result and display cells
cluster_3 = Cluster_7(geometry=deconstrucparking_3.PlanOutline, curve=deconstrucparking_3.PlanOutline)  # -> test_locs, curve_2, brep, colour_swatch
# cells address
cluster_4 = Cluster_4(data_3=deconstrucparking_3.Cells, data=deconstrucparking_3.Cells, matrix=deconstrucparking_3.PlanMatrix)  # -> group_3, geometry, paths, panel_3, colour_swatch
boundary_surfaces = BoundarySurfaces(Edges=deconstrucparking_4.CellsWithGrade)

one_over_x = OneOverX(Value=getpathlength.MaxLength)
series = Series(Start="0", Step=one_over_x, Count=number_slider)
gradient = Gradient(LowerLimit="0", UpperLimit="1", Parameter=series, stops=[0: RGB(128, 0, 0), 1: RGB(0, 0, 128)])
split_tree = SplitTree(Data=boundary_surfaces, Masks=flatten(concatenate))  # -> Positive, Negative

split_tree_2 = SplitTree(Data=deconstrucparking_3.LotInformations, Masks=flatten(concatenate))  # -> Positive, Negative
panel_2 = Panel(split_tree_2.Positive)
split_tree_3 = SplitTree(Data=boundary_surfaces, Masks=flatten(concatenate_2))  # -> Positive, Negative
area = Area(Geometry=split_tree_3.Positive)  # -> Area, Centroid
concatenate_3 = Concatenate(FragmentA="G", FragmentB=number_slider)
custom_preview = CustomPreview(Geometry=split_tree_3.Positive, Material=ColourSwatch(SwatchColor=RGB(0, 0, 0)))
text_tag_3d = TextTag3D(
    Location=area.Centroid,
    Text=concatenate_3,
    Size="1.5",
    Colour=ColourSwatch(SwatchColor=RGB(255, 247, 247)),
    Justification=5)
custom_preview_2 = CustomPreview(Geometry=split_tree.Positive, Material=graft(gradient))
cluster_5 = Cluster(T_2=split_tree_2.Positive, T=split_tree_2.Positive, whole=deconstrucparking_3.LotInformations)  # -> G, swatch, data_3, swatch_2
data_3 = Data(deconstrucparking_3.PathLines)
# ramp display
generalrampinformation = GeneralRampInformation()  # -> RampTypes, RampOrientations

# ----
# path Preview
cluster_6 = Cluster_11(
    pathpts=deconstrucparking_3.PathPoints,
    curve_2=deconstrucparking_3.PlanOutline,
    curve=deconstrucparking_3.EXcludedCells,
    path_lines=deconstrucparking_3.PathLines)  # -> surface_3, relay, relay_2, curves, panel_4
data_4 = Data(cluster_6.relay_2)
data_5 = Data(cluster_6.relay)

cluster_7 = Cluster_11(pathpts=deconstrucparking_3.PathPoints, curve_2=deconstrucparking_3.PlanOutline, curve=deconstrucparking_3.EXcludedCells)  # -> surface_3, relay, relay_2, curves, panel_4
relay = Relay()

# ----
# Vertical Access Preview
surface = Surface(deconstrucparking_3.EXcludedCells)
region_union = RegionUnion(Curves=surface)
area_2 = Area(Geometry=region_union)  # -> Area, Centroid
custom_preview_3 = CustomPreview(Geometry=surface, Material="11,11,46")
text_tag = TextTag(Location=area_2.Centroid, Text="vertical access", Colour=ColourSwatch(SwatchColor=RGB(242, 242, 242)))

cluster_8 = Cluster_12(
    parkings=split_tree_2.Positive,
    avg_len=getpathlength.TotalLength,
    B=getpathlength.MaxLength,
    geometry_2=deconstrucparking_3.PlanOutline,
    fragment_b=deconstrucparking_3.Score,
    geometry=deconstrucparking_3.PlanOutline,
    generation_time=deconstrucparking_3.GenerationTime,
    avg_circulation_turns=deconstrucparking_3.AvgDirectionShift,
    circulation_turns=deconstrucparking_3.PathDirectionShift)  # -> count, len, outline, score, run_time, circulation_turns_2
data_dam = DataDam(DataDataA=relay, BufferDelay=10000000, BufferMode=0)
cluster_9 = Cluster_3(
    L=deconstrucparking_3.RampInfo,
    L_2=generalrampinformation.RampOrientations,
    T=deconstrucparking_3.SideCellsAddress,
    T_2=generalrampinformation.RampTypes)  # -> G_2, swatch, C, G
# lable display
button = Button()

# ----
# Export jpeg
expression = Expression(Expression="true")
file_path = FilePath("G:\archtech\thesis\FatemeThesis\Visualization\imcap\sample parkings\04Opt Circulation Turn\")
data_dam_2 = DataDam(DataDataA=cluster_3.curve_2, BufferDelay=5000000, BufferMode=0)
data_dam_3 = DataDam(DataDataA=expression, BufferDelay=2500000, BufferMode=2)
printresult = PrintResult(SaveFolderPath=file_path, OutlineBoundingRectangle=data_dam_2, ParkingName="S_P2_Opt_", ResetPreviewSheet=button)

# ----
# Distributed Chart of Collection
cluster_10 = Cluster_9(relay_2=data_dam)  # -> point, colour, panel
dot_display = DotDisplay(Point=cluster_10.point, Colour=cluster_10.colour, Size=cluster_10.panel)

button_2 = Button()
data_6 = Data(deconstrucparking_3.ParkingEntranceCell)
panel_3 = Panel(data_6)
custom_preview_4 = CustomPreview(Geometry=cluster_6.relay_2, Material=cluster_6.panel_4)
custom_preview_5 = CustomPreview(Geometry=data_5, Material="11,11,46")
custom_preview_6 = CustomPreview(Geometry=cluster_6.relay_2, Material=cluster_6.panel_4)
text_tag_3d_2 = TextTag3D(
    Location=cluster_4.geometry,
    Text=graft(cluster_4.paths),
    Size=cluster_4.panel_3,
    Colour=cluster_4.colour_swatch,
    Justification=5)
custom_preview_7 = CustomPreview(Geometry=cluster_3.brep, Material=cluster_3.colour_swatch)
preview = CustomPreview(Geometry=cluster_9.G_2, Material=cluster_9.C)
preview_2 = CustomPreview(Geometry=cluster_9.G, Material=cluster_9.swatch)
preview_3 = CustomPreview(Geometry=cluster_5.data_3, Material=cluster_5.swatch_2)
custom_preview_8 = CustomPreview(Geometry=cluster_2.geometry, Material=cluster_2.colour_swatch)
custom_preview_9 = CustomPreview(Geometry=cluster_4.group_3, Material=cluster_4.colour_swatch)
custom_preview_10 = CustomPreview(Geometry=cluster.surface_2, Material=cluster.colour_swatch)
merge = Merge(
    Data1=cluster_8.count,
    Data2=cluster_8.outline,
    Data3=cluster_8.len,
    Data4=cluster_8.circulation_turns_2,
    Data5=cluster_8.run_time,
    Data6=cluster_8.score)
preview_4 = CustomPreview(Geometry=cluster_5.G, Material=cluster_5.swatch)
surface_2 = Surface(data_6)
custom_preview_11 = CustomPreview(Geometry=surface_2, Material="142,12,12")
text_tag_3d_3 = TextTag3D(Location=cluster_3.test_locs, Text=merge, Size=1, Colour=ColourSwatch(SwatchColor=RGBA(0, 0, 0, 217)), Justification=7)
preview_5 = CustomPreview(Geometry=cluster_5.G, Material=ColourSwatch(SwatchColor=RGBA(108, 112, 110, 164)))

# ==== cluster Cluster
whole = ClusterInput()
T = ClusterInput()
T_2 = ClusterInput()
swatch = ClusterOutput(ColourSwatch(SwatchColor=RGB(200, 224, 202)))

# ----
# parking lots display
crv = Curve([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])
surface = Surface([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])
group = Group(Objects=crv)
rotate = Rotate(Geometry=group, Angle=degrees("180"), Plane=PlaneXY(0, 0, 0))  # -> Geometry, Transform
transform = Transform(Geometry=rotate.Geometry, Transform=T)
data = Data(transform)

group_2 = Group(Objects=surface)

rotate_2 = Rotate(Geometry=group_2, Angle=degrees("180"), Plane=PlaneXY(0, 0, 0))  # -> Geometry, Transform
crv_2 = Curve(rotate_2.Geometry)
transform_2 = Transform(Geometry=rotate_2.Geometry, Transform=T_2)
data_2 = Data(transform_2)

transform_3 = Transform(Geometry=rotate_2.Geometry, Transform=whole)
data_3 = ClusterOutput(data)
swatch_2 = ClusterOutput(ColourSwatch(SwatchColor=RGB(9, 10, 9)))
G = ClusterOutput(transform_3)

# ==== cluster Cluster_3
T = ClusterInput()
L = ClusterInput()
T_2 = ClusterInput()
L_2 = ClusterInput()

# ----
# ramp info:
# 0: side
# 1: cell index on its side
# 2: ramp type
# 3: orientation
item = ListItem(List=L, Index=0, Wrap=True)  # -> Item, Item1, Item2, Item3

branch = TreeBranch(Tree=T, Path=item.Item, MaintainPaths=True)
branch_2 = TreeBranch(Tree=T_2, Path=item.Item2, MaintainPaths=True)
number_slider = Slider(5, range=0..10)
item_2 = ListItem(List=branch, Index=item.Item1, Wrap=True)
multiplication = Multiplication(A=branch_2, B=5)
addition = Addition(A=multiplication, B=item_2, C="{-2.5,-2.5,0}")
rectangle = Rectangle(Plane=addition, XSize=number_slider, YSize=number_slider, Radius=0)  # -> Rectangle, Length
item_3 = ListItem(List=rectangle.Rectangle, Index=0, Wrap=True)
boundary = BoundarySurfaces(Edges=rectangle.Rectangle)
lng = ListLength(List=rectangle.Rectangle)
area = Area(Geometry=item_3)  # -> Area, Centroid
cluster = Cluster_2(i=item.Item2, T="{-2.5,-2.5,0}")
range = Range(Domain="0 to 0.8", Steps=expr("x-1", lng))  # -> reverse(Range)
item_4 = ListItem(List=L_2, Index=item.Item3, Wrap=True)
move = Move(Geometry=boundary, Motion=expr("-x", area.Centroid))  # -> Geometry, Transform
gradient = Gradient(LowerLimit=0, UpperLimit=1, Parameter=range, stops=[0: RGB(192, 0, 0), 0: RGB(255, 255, 255), 1: RGB(128, 128, 128)])
transform = Transform(Geometry=move.Geometry, Transform=item_4)
transform_2 = Transform(Geometry=cluster, Transform=item_4)
move_2 = Move(Geometry=transform, Motion=area.Centroid)  # -> Geometry, Transform
move_3 = Move(Geometry=transform_2, Motion=area.Centroid)  # -> Geometry, Transform
swatch = ClusterOutput(ColourSwatch(SwatchColor=RGB(186, 168, 168)))
G = ClusterOutput(move_3.Geometry)
G_2 = ClusterOutput(move_2.Geometry)
C = ClusterOutput(gradient)

# ==== cluster Cluster_4
data = ClusterInput()
data_2 = Data(data)
matrix = ClusterInput()
data_3 = ClusterInput()

deconstruct_matrix = DeconstructMatrix(Matrix=matrix)  # -> Rows, Columns, Values
plasticanchor = PlasticAnchor(Limit=1, Strength=1, Reset=False)
data_4 = Data(data_3)
partition_list = PartitionList(List=deconstruct_matrix.Values, Size=deconstruct_matrix.Columns)
area = Area(Geometry=data_4)  # -> Area, Centroid
partition_list_2 = PartitionList(List=partition_list, Size="1")  # -> simplify(Chunks)

# ---- group: to remove 0 items in matrix
equality = Equality(FirstNumber=partition_list_2, SecondNumber=0)  # -> Equality, Inequality
tree_statistics = TreeStatistics(Tree=partition_list_2)  # -> Paths, Length, Count
dispatch = Dispatch(List=tree_statistics.Paths, DispatchPattern=flatten(equality.Inequality))  # -> ListA, ListB
tree_branch = TreeBranch(Tree=partition_list_2, Path=dispatch.ListA, MaintainPaths=True)

# ----
tree_statistics_2 = TreeStatistics(Tree=area.Centroid)  # -> Paths, Length, Count
tree_branch_2 = TreeBranch(Tree=partition_list_2, Path=tree_statistics_2.Paths, MaintainPaths=True)
move = Move(Geometry=area.Centroid, Motion="-1.7,-1.7,0")  # -> Geometry, Transform
tree_statistics_3 = TreeStatistics(Tree=tree_branch_2)  # -> Paths, Length, Count
panel = Panel("1")

panel_2 = Panel("""0.3
0.5
0.2""")
group = Group(Objects=data_2)
dash = DashPattern(Curve=data_2, Pattern=panel_2)  # -> Dashes, Gaps
colour_swatch = ClusterOutput(ColourSwatch(SwatchColor=RGB(0, 0, 0)))
geometry = ClusterOutput(move.Geometry)
panel_3 = ClusterOutput("0.5")
paths = ClusterOutput(tree_statistics_3.Paths)
panel_4 = Panel(dash.Dashes)
group_2 = Group(Objects=dash.Dashes)
group_3 = ClusterOutput(group_2)

# ==== cluster Cluster_5
relay = ClusterInput()

curve = Curve(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)
data = Data(relay)
area = Area(Geometry=curve)  # -> Area, Centroid
subtraction = Subtraction(A=data, B=area.Centroid)
surface = Surface(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)
graft_tree = GraftTree(Tree=subtraction, IncludeEmptyLists=True, IncludeNullItems=True)
move = Move(Geometry=surface, Motion=graft_tree)  # -> flatten(Geometry), Transform

geometry = ClusterOutput(move.Geometry)
colour_swatch = ClusterOutput(ColourSwatch(SwatchColor=RGB(160, 181, 136)))

# ==== cluster Cluster_7
geometry = ClusterInput()
curve = ClusterInput()

# ----
# preview outline
cluster = Cluster_6(curve=curve)

brep = ClusterOutput(cluster)
colour_swatch = ClusterOutput(ColourSwatch(SwatchColor=RGB(0, 0, 0)))
series = Series(Start="-3", Step="-2.5", Count="6")
construct_point = ConstructPoint(XCoordinate="5", YCoordinate=series, ZCoordinate=0)
test_locs = ClusterOutput(construct_point)

# ---- group: save preview results
bounding_rectangle = BoundingRectangle(Geometry=geometry, Plane=PlaneXY(0, 0, 0), Axis=0, Slide=0, Union=True)  # -> Bounding, DimensionX, DimensionY
rectangle = Rectangle(bounding_rectangle.Bounding)
boolean_toggle = BooleanToggle(True)

# ----
subtraction = Subtraction(A=bounding_rectangle.DimensionY, B=5)
addition = Addition(A=bounding_rectangle.DimensionX, B=5)
addition_2 = Addition(A=bounding_rectangle.DimensionX, B="15")
data = Data(flatten([bounding_rectangle.Bounding, construct_point]))
bounding_rectangle_2 = BoundingRectangle(Geometry=data, Plane=PlaneXY(0, 0, 0), Axis=0, Slide=0, Union=True)  # -> Bounding, DimensionX, DimensionY

# ---- group: save preview results (continued)
offset_curve = OffsetCurve(Curve=bounding_rectangle_2.Bounding, Distance="3", Corners=1)

# ----
curve_2 = ClusterOutput(offset_curve)

# ==== cluster Cluster_8
x_coordinate = ClusterInput()
y_coordinate = ClusterInput()
construct_point = ConstructPoint(XCoordinate=graft(x_coordinate), YCoordinate=y_coordinate, ZCoordinate=0)
curve = ClusterInput()
panel = Panel(ClusterInput())
point_in_curve = PointInCurve(Point=construct_point, Curve=curve)  # -> Relationship, Point
equality = Equality(FirstNumber=point_in_curve.Relationship, SecondNumber="0")  # -> Equality, Inequality
dispatch = Dispatch(List=construct_point, DispatchPattern=equality.Inequality)  # -> ListA, ListB
data = Data(dispatch.ListA)

division = Division(A="0.5", B=-2)
unit_x = UnitX(Factor=division)
unit_y = UnitY(Factor=division)
addition = Addition(A=unit_x, B=unit_y)
move = Move(Geometry=data, Motion=addition)  # -> Geometry, Transform

circle = Circle(Plane=data, Radius=".3")
rectangle = Rectangle(Plane=move.Geometry, XSize="0.5", YSize="0.5", Radius=0)  # -> Rectangle, Length
# display columns
surface = Surface(circle)
colour_swatch = ClusterOutput(ColourSwatch(SwatchColor=RGB(0, 15, 51)))
surface_2 = ClusterOutput(surface)

# ==== cluster Cluster_9
relay = ClusterInput()
relay_2 = ClusterInput()
selectparking = SelectParking(Generations=relay, ParkingId=relay_2)
deconstrucparking = DeconstrucParking(Parking=graft(selectparking))  # -> Score, PlanMatrix, PathPoints, LotInformations, Cells, SideCellsAddress, EXcludedCells, ParkingEntranceCell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
deconstruct_matrix = DeconstructMatrix(Matrix=deconstrucparking.PlanMatrix)  # -> Rows, Columns, Values
# path
equality = Equality(FirstNumber=deconstruct_matrix.Values, SecondNumber="3")  # -> Equality, Inequality
# lot
equality_2 = Equality(FirstNumber=deconstruct_matrix.Values, SecondNumber="2")  # -> Equality, Inequality
# Distributed Chart of collection
number_slider = Slider(100, range=0..100)
mass_addition = MassAddition(Input=equality_2.Equality)  # -> flatten(Result), PartialResults
mass_addition_2 = MassAddition(Input=equality.Equality)  # -> flatten(Result), PartialResults
multiplication = Multiplication(A=deconstrucparking.Score, B=number_slider)  # -> flatten(Result)
construct_point = ConstructPoint(XCoordinate=mass_addition.Result, YCoordinate=mass_addition_2.Result, ZCoordinate=expr("x/2", multiplication))
point = ClusterOutput(construct_point)
colour_rgb = ColourRGB(Alpha="255", Red=expr("x*5", multiplication), Green=expr("x*2", multiplication), Blue=Slider(49, range=0..1000))  # -> reverse(Colour)
panel = ClusterOutput(".5")
colour = ClusterOutput(colour_rgb)

# ==== cluster Cluster_11
pathpts = ClusterInput()
pathpts_2 = Data(flatten(pathpts))
path_lines = ClusterInput()
curve = ClusterInput()
point_in_curve = PointInCurve(Point=pathpts_2, Curve=graft(curve))  # -> Relationship, Point
explode_tree = ExplodeTree(Data=point_in_curve.Relationship)  # -> Branch0, Branch1, Branch2, Branch3
addition = Addition(A=explode_tree.Branch0, B=explode_tree.Branch1, C=explode_tree.Branch2, D=explode_tree.Branch3)
curve_2 = ClusterInput()
equality = Equality(FirstNumber=addition, SecondNumber="0")  # -> Equality, Inequality
point_in_curve_2 = PointInCurve(Point=pathpts_2, Curve=curve_2)  # -> Relationship, Point
equality_2 = Equality(FirstNumber=point_in_curve_2.Relationship, SecondNumber="2")  # -> Equality, Inequality
gate_and = GateAnd(A=equality_2.Equality, B=equality.Equality)
dispatch = Dispatch(List=pathpts_2, DispatchPattern=gate_and)  # -> ListA, ListB
mst = MST(BasePoints=dispatch.ListA)  # -> PointPointTopology, ConnectionPointTopology, Lines
length = Length(Curve=mst.Lines)

# ----
# filter conncetion lines not
# vertical or horizontal
cluster = Cluster_10(first_number=length, list=mst.Lines)

number_slider = Slider(0.3, range=0..1)
# path display
join_curves = JoinCurves(Curves=path_lines, Preserve=False)
offset_curve = OffsetCurve(Curve=join_curves, Distance=expr("-x", number_slider), Corners=1)
offset_curve_2 = OffsetCurve(Curve=join_curves, Distance=number_slider, Corners=1)
end_points = EndPoints(Curve=offset_curve_2)  # -> Start, End
end_points_2 = EndPoints(Curve=offset_curve)  # -> Start, End
line = Line(StartPoint=end_points.Start, EndPoint=end_points_2.Start)
line_2 = Line(StartPoint=end_points.End, EndPoint=end_points_2.End)
join_curves_2 = JoinCurves(Curves=[offset_curve_2, offset_curve, line, line_2], Preserve=False)
region_union = RegionUnion(Curves=flatten(join_curves_2))
fillet_distance = FilletDistance(Curve=region_union, Distance=Slider(0.2, range=0..1))
surface = Surface(fillet_distance)

curves = ClusterOutput(join_curves)
number_slider_2 = Slider(0.1, range=0..1)

panel = Panel("""1.5
1""")
number_slider_3 = Slider(0.1, range=0..0.1)
dash_pattern = DashPattern(Curve=join_curves, Pattern=panel)  # -> Dashes, Gaps
panel_2 = Panel(".04")
offset_curve_3 = OffsetCurve(Curve=dash_pattern.Dashes, Distance=expr("-x", number_slider_2), Corners=1)
offset_curve_4 = OffsetCurve(Curve=dash_pattern.Dashes, Distance=number_slider_2, Corners=1)
end_points_3 = EndPoints(Curve=offset_curve_4)  # -> Start, End
end_points_4 = EndPoints(Curve=offset_curve_3)  # -> Start, End
line_3 = Line(StartPoint=end_points_3.Start, EndPoint=end_points_4.Start)
line_4 = Line(StartPoint=end_points_3.End, EndPoint=end_points_4.End)
join_curves_3 = JoinCurves(Curves=[line_3, line_4, offset_curve_4, offset_curve_3], Preserve=False)
panel_3 = Panel("11,11,45")
surface_2 = Surface(join_curves_3)

panel_4 = ClusterOutput("229,229,26")
surface_3 = ClusterOutput(surface_2)
relay = ClusterOutput(surface_2)
relay_2 = ClusterOutput(surface)

# ==== cluster Cluster_12
avg_len = ClusterInput()
B = ClusterInput()
parkings = ClusterInput()
list_length = ListLength(List=flatten(parkings))  # -> expr("x*2", Length)
geometry = ClusterInput()
geometry_2 = ClusterInput()
avg_circulation_turns = ClusterInput()
generation_time = ClusterInput()
circulation_turns = ClusterInput()
area = Area(Geometry=geometry)  # -> Area, Centroid
area_2 = Area(Geometry=geometry_2)  # -> Area, Centroid
fragment_b = ClusterInput()
concatenate = Concatenate(FragmentA="Parking Count:", FragmentB=list_length)
concatenate_2 = Concatenate(Fragment_A="Avg Path Length: ", Fragment_B=avg_len, C="   ", A="Max Path Length: ", B=B)
concatenate_3 = Concatenate(
    Fragment_A="Avg Circulation Turns: ",
    Fragment_B=avg_circulation_turns,
    A="    ",
    B="Total Circulation Turns: ",
    C=circulation_turns)
concatenate_4 = Concatenate(FragmentA="Run Time(ms): ", FragmentB=generation_time)
concatenate_5 = Concatenate(Fragment_A="Internal Outline Area: ", Fragment_B=area_2.Area, A="m2")
concatenate_6 = Concatenate(FragmentA="Parking Score: ", FragmentB=fragment_b)
len = ClusterOutput(concatenate_2)
run_time = ClusterOutput(concatenate_4)
circulation_turns_2 = ClusterOutput(concatenate_3)
outline = ClusterOutput(concatenate_5)
score = ClusterOutput(concatenate_6)
# add lable to results
count = ClusterOutput(concatenate)

# ==== cluster Cluster_2
i = ClusterInput()
T = ClusterInput()

geo = Geometry([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])
join = JoinCurves(Curves=geo, Preserve=False)
geo_2 = Geometry([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])
geo_3 = Geometry([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])
geo_4 = Geometry([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])
geo_5 = Geometry([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])
geo_6 = Geometry([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])
group = Group(Objects=geo)
group_2 = Group(Objects=geo_4)
group_3 = Group(Objects=geo_3)
group_4 = Group(Objects=geo_6)
group_5 = Group(Objects=geo_5)
group_6 = Group(Objects=geo_2)
merge = Merge(Data1=group, Data2=group_2, Data3=group_3, Data4=group_4, Data5=group_5, Data6=group_6)
item = ListItem(List=merge, Index=i, Wrap=True)
scale = Scale(Geometry=item, Center=Point(0, 0, 0), Factor="5")  # -> Geometry, Transform
move = Move(Geometry=scale.Geometry, Motion=T)  # -> Geometry, Transform
rotate = Rotate(Geometry=move.Geometry, Angle="pi/2", Plane=PlaneXY(0, 0, 0))  # -> Geometry, Transform

G = ClusterOutput(rotate.Geometry)

# ==== cluster Cluster_6
curve = ClusterInput()
data = ClusterInput()
simplify_curve = SimplifyCurve(Curve=curve)  # -> Curve, Simplified
data_2 = Data(data)
offset_curve = OffsetCurve(Curve=simplify_curve.Curve, Distance=".3", Corners=1)
end_points = EndPoints(Curve=simplify_curve.Curve)  # -> Start, End
end_points_2 = EndPoints(Curve=offset_curve)  # -> Start, End
line = Line(StartPoint=end_points_2.Start, EndPoint=end_points.Start)
sweep2 = Sweep2(Rail1=simplify_curve.Curve, Rail2=offset_curve, Sections=line, SameHeight=False)
brep = ClusterOutput(sweep2)

# ==== cluster Cluster_10
first_number = ClusterInput()
larger_than = LargerThan(FirstNumber=first_number, SecondNumber=0)  # -> LargerThan, OrEqualTo
list = ClusterInput()
dispatch = Dispatch(List=list, DispatchPattern=larger_than.LargerThan)  # -> ListA, ListB
unit_x = UnitX(Factor="1")
angle = Angle(VectorA=dispatch.ListA, VectorB=unit_x)  # -> Angle, Reflex
equality = Equality(FirstNumber=angle.Angle, SecondNumber="0")  # -> Equality, Inequality
equality_2 = Equality(FirstNumber=angle.Angle, SecondNumber="0.5 * pi")  # -> Equality, Inequality
gate_or = GateOr(A=equality_2.Equality, B=equality.Equality)
dispatch_2 = Dispatch(List=dispatch.ListA, DispatchPattern=gate_or)  # -> ListA, ListB
list_a = ClusterOutput(dispatch_2.ListA)
